# Grasshopper definition Hops_singleZone.gh (Grasshopper 1.0.7)
# plug-ins: Hops

roomgeometry = Geometry(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)
climatezones = HBClimateZones({"1 - Very Hot": "1", "2 - Hot": "2", "3 - Warm": "3", "4 - Mixed": "4", "5 - Cool": "5", "6 - Cold": "6", "7 - Very Cold": "7", "8 - Subarctic": "8"}, selected="4 - Mixed")

climatezones_2 = HBClimateZones({"1 - Very Hot": "1", "2 - Hot": "2", "3 - Warm": "3", "4 - Mixed": "4", "5 - Cool": "5", "6 - Cold": "6", "7 - Very Cold": "7", "8 - Subarctic": "8"}, selected="4 - Mixed")
roomgeometry_2 = Geometry(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)

toggle = BooleanToggle(True)
hops = Hops(
    RoomGeometry=roomgeometry,
    RoomName="HopsEnergyTest",
    ClimateZoneNumber=climatezones,
    ModelName="LargeOffice_WWR-0.75",
    ApertureFromInput=Toggle(False),
    RunSimulation=toggle,
    WWR="0.75",
    CacheResultsInMemory=False,
    CacheSolveResults=False,
    RemoteDefinitionLocation="C:\Users\karimd\ladybug-tools-1-4-0\samples\honeybee-energy\KarimsVersion\single_zone_energy_model_v0.1.gh",
    RemoteSolveVersion=(0, 1, 0),
    ShowInput_Enabled=False,
    ShowInput_Path=False,
    SynchronousSolve=True)  # -> HBModel, Sql
hops_2 = Hops(
    RoomGeometry=roomgeometry_2,
    RoomName="HopsEnergyTest2",
    ClimateZoneNumber=climatezones_2,
    ModelName="LargeOffice_WWR-0.5",
    ApertureFromInput=Toggle(False),
    RunSimulation=toggle,
    WWR="0.5",
    CacheResultsInMemory=False,
    CacheSolveResults=False,
    RemoteDefinitionLocation="C:\Users\karimd\ladybug-tools-1-4-0\samples\honeybee-energy\KarimsVersion\single_zone_energy_model_v0.1.gh",
    RemoteSolveVersion=(0, 1, 0),
    ShowInput_Enabled=False,
    ShowInput_Path=False,
    SynchronousSolve=True)  # -> HBModel, Sql
cluster = Cluster(hbobjects_strings=hops.HBModel, sql_data=hops.Sql)
cluster_2 = Cluster(hbobjects_strings=hops_2.HBModel, sql_data=hops_2.Sql)

# ---- group: Visualize Model
list = ValueList({"Hide all": 0, "Building Element": 1, "Boundary Condition": 2}, selected="Building Element")
vm = VM(S=cluster_2, G=list)

list_2 = ValueList({"Hide all": 0, "Building Element": 1, "Boundary Condition": 2}, selected="Building Element")
vm_2 = VM(S=cluster, G=list_2)

# ==== cluster VM
S = ClusterInput()
G = ClusterInput()
gate = StreamGate(Stream=S, Gate=G)  # -> Target0, Target1, Target2
vizbytype = HBVisualizeByType(hb_objs=gate.Target1)  # -> walls, interior_walls, roofs, ceilings, exterior_floors, interior_floors, air_walls, apertures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; plug-in component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
vizbybc = HBVisualizeByBC(hb_objs=gate.Target2)  # -> outdoors, surface, ground, adiabatic, other, wire_frame; plug-in component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

# ==== cluster Cluster
hbobjects_strings = ClusterInput()
sql_data = ClusterInput()
hbobjects_strings_2 = Data(hbobjects_strings)
sql_data_2 = Data(sql_data)

# ----
# Compute EUI
eui = HBEndUseIntensity(sql=sql_data_2)  # -> eui, eui_end_use, end_uses, gross_floor; plug-in component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
eui_kwh_m2 = Panel(eui.eui)
panel = Panel(eui.end_uses)
panel_2 = Panel(eui.eui_end_use)

# ----
# Import
# Results
faceresult = HBReadFaceResult(sql=sql_data_2)  # -> face_indoor_temp, face_outdoor_temp, face_energy_flow; plug-in component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
roomenergyresult = HBReadRoomEnergyResult(sql=sql_data_2)  # -> cooling, heating, lighting, electric_equip, gas_equip, process, hot_water, fan_electric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; plug-in component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
strtoobj = HBStringToObject(hb_str=hbobjects_strings_2)  # -> hb_obj; plug-in component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

hb_obj = ClusterOutput(strtoobj)
hbobjects = Data(strtoobj)

# ----
# Plot Results
panel_3 = Panel("50, 0, 0")
hourlyplot = LBHourlyPlot(data=roomenergyresult.cooling, base_pt=panel_3)  # -> report, mesh, legend, borders, labels, title; plug-in component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

concat = Concatenate(FragmentA="EUI (kWh/m2)", FragmentB=eui_kwh_m2, JoinSeparator="=")

# ----
# Construct Energy Balance
loadbalance = HBThermalLoadBalance(
    rooms_model=flatten(hbobjects),
    cooling=roomenergyresult.cooling,
    heating=roomenergyresult.heating,
    lighting=roomenergyresult.lighting,
    electric_equip=roomenergyresult.electric_equip,
    hot_water=roomenergyresult.hot_water,
    people_gain=roomenergyresult.people_gain,
    solar_gain=roomenergyresult.solar_gain,
    infiltration_load=roomenergyresult.infiltration_load,
    mech_vent_load=roomenergyresult.mech_vent_load,
    face_energy_flow=faceresult.face_energy_flow)  # -> report, balance, balance_stor, norm_bal, norm_bal_stor; plug-in component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
timeop = LBTimeIntervalOperation(data=loadbalance.balance)  # -> daily, monthly, mon_per_hr; plug-in component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
colrange = LBColorRange(index="19")  # -> colors; plug-in component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
legendpar = LBLegendParameters(colors=colrange, num_decimals="1", text_height="1.5")  # -> leg_par; plug-in component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
monthlychart = LBMonthlyChart(data=timeop.monthly, base_pt="-200, 0, 0", y_dim="30", stack=Toggle(True), global_title=concat, legend_par=legendpar)  # -> report, data_mesh, data_lines, col_lines, legend, borders, labels, y_title, title; plug-in component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

panel_4 = Panel(timeop.monthly)
