# Grasshopper definition single_zone_energy_model_v0.1.ghx (Grasshopper 1.0.7)

climatezones = HBClimateZones({"1 - Very Hot": "1", "2 - Hot": "2", "3 - Warm": "3", "4 - Mixed": "4", "5 - Cool": "5", "6 - Cold": "6", "7 - Very Cold": "7", "8 - Subarctic": "8"}, selected="4 - Mixed")
panel = Panel("HopsEnergyTest")
toggle = BooleanToggle(True)
roomgeometry = Geometry(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)
roomgeometry_2 = GetGeometry(AtLeast=1, AtMost=1, DeleteInput=False, Filter=1074004029)
climatezonenumber = GetNumber(AtLeast=1, AtMost=1, Maximum=1.797693135e+308, Minimum=-1.797693135e+308)
aperturefrominput = GetBoolean(AtLeast=1, AtMost=1, FalseValue="False", TrueValue="True")
roomname = GetString(AtLeast=1, AtMost=1)
modelname = GetString(AtLeast=1, AtMost=1)
wwr = GetNumber(AtLeast=1, AtMost=1, Maximum=1.797693135e+308, Minimum=-1.797693135e+308)

# ---- group: Choose Construction Set based on Climate - Ashrae 90.1
climatezones_2 = HBClimateZones({"1 - Very Hot": "1", "2 - Hot": "2", "3 - Warm": "3", "4 - Mixed": "4", "5 - Cool": "5", "6 - Cold": "6", "7 - Very Cold": "7", "8 - Subarctic": "8"}, selected="4 - Mixed")
constructiontypes = HBConstructionTypes({"SteelFramed", "WoodFramed", "Mass", "Metal Building"}, selected="SteelFramed")
constrsetclimate = HBConstructionSetByClimate(climate_zone=climatezonenumber, constr_type=constructiontypes)  # -> constr_set; plug-in component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

# ---- group: Choose Program
bldgprograms = HBBuildingPrograms({"LargeOffice", "MediumOffice", "SmallOffice", "MidriseApartment", "HighriseApartment", "Retail", "StripMall", "PrimarySchool", "SecondarySchool", "SmallHotel", "LargeHotel", "Hospital", "Outpatient", "Laboratory", "Warehouse", "SuperMarket", "FullServiceRestaurant", "QuickServiceRestaurant", "Courthouse", "LargeDataCenterHighITE", "LargeDataCenterLowITE", "SmallDataCenterHighITE", "SmallDataCenterLowITE"}, selected="LargeOffice")

# ---- group: WWR
panel_2 = Panel(wwr)

# ---- group: Input Geometry
roomgeometry_3 = Geometry(roomgeometry_2)
panel_3 = Panel(roomname)

# ---- group: Depth of Apeture
panel_4 = Panel("0.1")

# ----
list = ValueList({"Aperture from Input": 1, "Aperture by WWR": 0}, selected="Aperture from Input")
operablewindows = BooleanToggle(True)
roomaperture = Geometry([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])
aperture = HBAperture(geo=roomaperture, operable=operablewindows)  # -> report, apertures; plug-in component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
bordershades = HBExtrudedBorderShades(hb_objs=flatten(aperture.apertures), depth=panel_4)  # -> report, hb_objs; plug-in component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

# ---- group: Shading Geometry
shadinggeometry = Geometry([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])
shade = HBShade(geo=shadinggeometry)  # -> report, shades; plug-in component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

# ----
panel_5 = Panel(panel_3)
aperturemethod = Data(aperturefrominput)
construction_set = Data(constrsetclimate)
roomgeometry_4 = Geometry(roomgeometry_3)
program_type = Data(bldgprograms)
apertures = Data(bordershades.hb_objs)
shades = Data(shade.shades)

wwr_2 = Panel(panel_2)
operable = Data(operablewindows)

data = Data(2)
data_2 = Data(2)

data_3 = Data(2)
data_4 = Data(2)

# ----
# Request Outputs
toggle_2 = BooleanToggle(True)
simoutput = HBSimulationOutput(zone_energy_use=toggle_2, gains_and_losses=toggle_2, surface_energy_flow=toggle_2)  # -> report, sim_output; plug-in component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
simpar = HBSimulationParameter(output=simoutput.sim_output, timestep=6)  # -> sim_par; plug-in component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

# ---- group: EPW
# Download EPW File
panel_6 = Panel("http://climate.onebuilding.org/WMO_Region_4_North_and_Central_America/USA_United_States_of_America/CA_California/USA_CA_Burbank-Hope.AP.722880_TMY3.zip")
downloadepw = LBDownloadWeather(weather_URL=panel_6)  # -> epw_file, stat_file, ddy_file; plug-in component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

# ----
# Run Simulation
data_5 = Data(2)
data_6 = Data(2)

run_simulation = GetBoolean(AtLeast=1, AtMost=1, FalseValue="False", TrueValue="True")

data_7 = Data(2)
data_8 = Data(2)

# ---- group: Visualize Model
list_2 = ValueList({"Hide all": 0, "Building Element": 1, "Boundary Condition": 2}, selected="Building Element")

# ----
# Setup Model
roomsolid = HBRoomFromSolid(geo=flatten(roomgeometry_4), name=panel_5, constr_set=construction_set, program=program_type, conditioned=True)  # -> report, rooms; plug-in component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

aperturemethod_2 = Data(aperturemethod)
apertures_2 = Data(apertures)
wwr_3 = Panel(wwr_2)
hbrooms = Data(roomsolid.rooms)
operable_2 = Data(operable)

aperturesbyratio = HBAperturesByRatio(hb_objs=flatten(roomsolid.rooms), ratio=wwr_3, operable=operable_2)  # -> report, hb_objs; plug-in component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
addsubface = HBAddSubface(hb_obj=flatten(hbrooms), sub_faces=flatten(apertures_2))  # -> hb_obj; plug-in component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
filter = StreamFilter(Gate=aperturemethod_2, Stream0=aperturesbyratio.hb_objs, Stream1=addsubface)

# ---- group: Visualize Model (continued)
# Inputs
vm = VM(S=filter, G=list_2)

# ----
house_rooms = Data(flatten(filter))
shades_2 = Data(shades)

# ----
# Create Model
house_rooms_2 = Data(flatten(house_rooms))
panel_7 = Panel(modelname)
shades_3 = Data(flatten(shades_2))

model = HBModel(rooms=flatten(house_rooms_2), shades=flatten(shades_3), name=panel_7)  # -> report, model; plug-in component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

simulationparameters = Data(simpar)
epw_file = Data(downloadepw.epw_file)
model_2 = Data(model.model)

objtostr = HBObjectToString(hb_obj=model_2)  # -> hb_str; plug-in component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
modeltoosm = HBModelToOSM(model=model_2, epw_file=epw_file, sim_par=simulationparameters, write=run_simulation, run=run_simulation)  # -> report, jsons, osw, osm, idf, sql, zsz, rdd, html; plug-in component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

# ---- group: RH_OUT:HBModel
hbmodel = Data(objtostr)

# ----
context_print = ContextPrint(Text=modeltoosm.sql)

# ----
# Compute EUI
eui = HBEndUseIntensity(sql=modeltoosm.sql)  # -> eui, eui_end_use, end_uses, gross_floor; plug-in component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
eui_kwh_m2 = Panel(eui.eui)
panel_8 = Panel(eui.end_uses)
panel_9 = Panel(eui.eui_end_use)

# ----
# Import
# Results
faceresult = HBReadFaceResult(sql=modeltoosm.sql)  # -> face_indoor_temp, face_outdoor_temp, face_energy_flow; plug-in component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
roomenergyresult = HBReadRoomEnergyResult(sql=modeltoosm.sql)  # -> cooling, heating, lighting, electric_equip, gas_equip, process, hot_water, fan_electric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; plug-in component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

data_9 = Data(model_2)

# ----
# Construct Energy Balance
loadbalance = HBThermalLoadBalance(
    rooms_model=flatten(data_9),
    cooling=roomenergyresult.cooling,
    heating=roomenergyresult.heating,
    lighting=roomenergyresult.lighting,
    electric_equip=roomenergyresult.electric_equip,
    hot_water=roomenergyresult.hot_water,
    people_gain=roomenergyresult.people_gain,
    solar_gain=roomenergyresult.solar_gain,
    infiltration_load=roomenergyresult.infiltration_load,
    mech_vent_load=roomenergyresult.mech_vent_load,
    face_energy_flow=faceresult.face_energy_flow)  # -> report, balance, balance_stor, norm_bal, norm_bal_stor; plug-in component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
timeop = LBTimeIntervalOperation(data=loadbalance.norm_bal_stor)  # -> daily, monthly, mon_per_hr; plug-in component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
colrange = LBColorRange(index="19")  # -> colors; plug-in component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
legendpar = LBLegendParameters(colors=colrange, num_decimals="1", text_height="1.5")  # -> leg_par; plug-in component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
monthlychart = LBMonthlyChart(data=timeop.monthly, base_pt="-200, 0, 0", y_dim="30", stack=Toggle(True), legend_par=legendpar)  # -> report, data_mesh, data_lines, col_lines, legend, borders, labels, y_title, title; plug-in component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

# ----
# Plot Results
panel_10 = Panel("50, 0, 0")
hourlyplot = LBHourlyPlot(data=roomenergyresult.cooling, base_pt=panel_10)  # -> report, mesh, legend, borders, labels, title; plug-in component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

panel_11 = Panel(loadbalance.norm_bal_stor)

# ==== cluster VM
S = ClusterInput()
G = ClusterInput()
gate = StreamGate(Stream=S, Gate=G)  # -> Target0, Target1, Target2
vizbytype = HBVisualizeByType(hb_objs=gate.Target1)  # -> walls, interior_walls, roofs, ceilings, exterior_floors, interior_floors, air_walls, apertures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; plug-in component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
vizbybc = HBVisualizeByBC(hb_objs=gate.Target2)  # -> outdoors, surface, ground, adiabatic, other, wire_frame; plug-in component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
